# Grasshopper definition des_ghe_example.gh (Grasshopper 1.0.8)

# ----
# Construction Set
bldg_vintage = Dragonfly_BldgAge({"ASHRAE 90.1 2013  |  IECC 2015": "2013", "ASHRAE 90.1 2010  |  IECC 2012": "2010", "ASHRAE 90.1 2007  |  IECC 2009": "2007", "ASHRAE 90.1 2004  |  IECC 2006": "2004", "1980-2004 (CBECS)": "1980_2004", "Pre-1980 (CBECS)": "pre_1980"}, selected="ASHRAE 90.1 2013  |  IECC 2015")
constr_type = Dragonfly_BldgAge({"SteelFramed", "WoodFramed", "Mass", "Metal Building"}, selected="SteelFramed")
climate_zone = Dragonfly_BldgAge({"1 - Very Hot": "1", "2 - Hot": "2", "3 - Warm": "3", "4 - Mixed": "4", "5 - Cool": "5", "6 - Cold": "6", "7 - Very Cold": "7", "8 - Subarctic": "8"}, selected="5 - Cool")
constrsetclimate = HBConstructionSetByClimate(climate_zone=climate_zone, vintage=bldg_vintage, constr_type=constr_type)  # -> constr_set; plug-in component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

# ----
# Order Programs
# to Match Footprints
bldgprograms = HBBuildingPrograms({"LargeOffice", "MediumOffice", "SmallOffice", "MidriseApartment", "HighriseApartment", "Retail", "StripMall", "PrimarySchool", "SecondarySchool", "SmallHotel", "LargeHotel", "Hospital", "Outpatient", "Laboratory", "Warehouse", "SuperMarket", "FullServiceRestaurant", "QuickServiceRestaurant", "Courthouse", "LargeDataCenterHighITE", "LargeDataCenterLowITE", "SmallDataCenterHighITE", "SmallDataCenterLowITE"}, selected="MidriseApartment")
bldgprograms_2 = HBBuildingPrograms({"LargeOffice", "MediumOffice", "SmallOffice", "MidriseApartment", "HighriseApartment", "Retail", "StripMall", "PrimarySchool", "SecondarySchool", "SmallHotel", "LargeHotel", "Hospital", "Outpatient", "Laboratory", "Warehouse", "SuperMarket", "FullServiceRestaurant", "QuickServiceRestaurant", "Courthouse", "LargeDataCenterHighITE", "LargeDataCenterLowITE", "SmallDataCenterHighITE", "SmallDataCenterLowITE"}, selected="Outpatient")
bldgprograms_3 = HBBuildingPrograms({"LargeOffice", "MediumOffice", "SmallOffice", "MidriseApartment", "HighriseApartment", "Retail", "StripMall", "PrimarySchool", "SecondarySchool", "SmallHotel", "LargeHotel", "Hospital", "Outpatient", "Laboratory", "Warehouse", "SuperMarket", "FullServiceRestaurant", "QuickServiceRestaurant", "Courthouse", "LargeDataCenterHighITE", "LargeDataCenterLowITE", "SmallDataCenterHighITE", "SmallDataCenterLowITE"}, selected="MediumOffice")
bldgprograms_4 = HBBuildingPrograms({"LargeOffice", "MediumOffice", "SmallOffice", "MidriseApartment", "HighriseApartment", "Retail", "StripMall", "PrimarySchool", "SecondarySchool", "SmallHotel", "LargeHotel", "Hospital", "Outpatient", "Laboratory", "Warehouse", "SuperMarket", "FullServiceRestaurant", "QuickServiceRestaurant", "Courthouse", "LargeDataCenterHighITE", "LargeDataCenterLowITE", "SmallDataCenterHighITE", "SmallDataCenterLowITE"}, selected="StripMall")
merge = Merge(
    Data1=bldgprograms_3,
    Data2=bldgprograms_3,
    Data3=bldgprograms,
    Data4=bldgprograms,
    Data5=bldgprograms_2,
    Data6=bldgprograms_4)  # -> simplify(graft(Result))

# ----
# Basic Building Properties
floor_to_floor_m = Panel("3.5")
building_names = Panel("""Office 1
Office 2
Residential 1
Residential 2
Outpatient
Strip Mall""")
number_of_stories = Panel("""6
10
3
6
10
1""")
footprints = Geometry(simplify(graft([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])))
perimeter_depth_m = Panel("10")
data = Data(simplify(graft(building_names)))
dup = DuplicateData(Data=floor_to_floor_m, Number=number_of_stories, Order=True)  # -> simplify(Data)

# ----
# Create Buildings
buildingfootprint = DFBuildingFromFootprint(
    footprint_geo=footprints,
    floor_to_floor=dup,
    perim_offset=perimeter_depth_m,
    name=data,
    program=merge,
    constr_set=constrsetclimate,
    run=Toggle(True))  # -> report, buildings; plug-in component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
topbottom = DFSeparateTopBottom(buildings=buildingfootprint.buildings)  # -> simplify(buildings); plug-in component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

# ----
# Assign Windows
window_ratios_per_building = Panel("""0.4
0.4
0.25
0.25
0.4
0.3""")
simpleratiopar = DFSimpleWindowRatioParameters(ratio=window_ratios_per_building)  # -> simplify(graft(win_par)); plug-in component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
applyfacadepar = DFApplyFacadeParameters(df_obj=topbottom, win_par=simpleratiopar)  # -> report, df_obj; plug-in component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

# ----
# Assign HVAC System
doas = HBDOASHVACTemplates({"DOAS with fan coil chiller with boiler": "DOAS_FCU_Chiller_Boiler", "DOAS with fan coil chiller with central air source heat pump": "DOAS_FCU_Chiller_ASHP", "DOAS with fan coil chiller with district hot water": "DOAS_FCU_Chiller_DHW", "DOAS with fan coil chiller with baseboard electric": "DOAS_FCU_Chiller_ElectricBaseboard", "DOAS with fan coil chiller with gas unit heaters": "DOAS_FCU_Chiller_GasHeaters", "DOAS with fan coil chiller with no heat": "DOAS_FCU_Chiller", "DOAS with fan coil air-cooled chiller with boiler": "DOAS_FCU_ACChiller_Boiler", "DOAS with fan coil air-cooled chiller with central air source heat pump": "DOAS_FCU_ACChiller_ASHP", "DOAS with fan coil air-cooled chiller with district hot water": "DOAS_FCU_ACChiller_DHW", "DOAS with fan coil air-cooled chiller with baseboard electric": "DOAS_FCU_ACChiller_ElectricBaseboard"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}, selected="DOAS with fan coil district chilled water with district hot water": "DOAS_FCU_DCW_DHW")
dfdoashvac = DFDOASHVAC(df_objs=flatten(applyfacadepar.df_obj), system_type=doas, sensible_hr="0.8", latent_hr="0.75", dcv=Toggle(True))  # -> report, df_objs; plug-in component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

# ----
# Create GHE
# District System
panel = Panel("50")
gheborehole = DFGHEBoreholeParameter(min_spacing="3", max_spacing=panel, max_depth="300")  # -> borehole; plug-in component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
horizpipe = DFHorizontalPipeParameter()  # -> horiz_pipe; plug-in component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
ghepipe = DFGHEPipeParameter()  # -> pipe; plug-in component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
ghesoil = DFGHESoilParameter()  # -> soil; plug-in component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
ghefluid = DFGHEFluidParameter()  # -> fluid; plug-in component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
ground_heat_exchanger = Geometry([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])
ghedesign = DFGHEDesignParameter()  # -> design; plug-in component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
thermalconnectors = Geometry([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])
gheloop = DFGHEThermalLoop(
    ghe_geo=flatten(ground_heat_exchanger),
    connector_geo=flatten(thermalconnectors),
    clockwise=Toggle(False),
    borehole=gheborehole,
    soil=ghesoil,
    fluid=ghefluid,
    pipe=ghepipe,
    horiz_pipe=horizpipe,
    design=ghedesign,
    heat_rejection="CoolingTower",
    supplement_heat="None",
    name="District GHE Loop")  # -> report, des_loop; plug-in component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

# ----
# Assign SHW System
shw = HBSHWTemplates({"Gas Water Heater": "Gas_WaterHeater", "Electric Water Heater": "Electric_WaterHeater", "Heat Pump Water Heater": "HeatPump_WaterHeater", "Gas Tankless Heater": "Gas_TanklessHeater", "Electric Tankless Heater": "Electric_TanklessHeater", "District Water Heater": "District_WaterHeater", "District Tankless Heater": "District_TanklessHeater"}, selected="District Water Heater")
shw_2 = DFSHWSystem(df_objs=flatten(dfdoashvac.df_objs), system_type=shw)  # -> report, df_objs; plug-in component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

# ----
# Customize the
# Building Eneergy
# Transfer Station
panel_2 = Panel("3.0")
heatpumpets = DFBuildingHeatPumpETS(building=shw_2.df_objs, heating_temp="40", cop_heating=panel_2)  # -> building; plug-in component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

# ----
# Create Model
panel_3 = Panel("DES_GHE_Example")
model = DFModel(buildings=flatten(heatpumpets), name=panel_3)  # -> report, model; plug-in component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

# ----
# Download EPW File
panel_4 = Panel("https://energyplus-weather.s3.amazonaws.com/north_and_central_america_wmo_region_4/USA/NY/USA_NY_Buffalo-Greater.Buffalo.Intl.AP.725280_TMY/USA_NY_Buffalo-Greater.Buffalo.Intl.AP.725280_TMY.zip")
downloadepw = LBDownloadWeather(weather_URL=panel_4)  # -> epw_file, stat_file, ddy_file; plug-in component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

# ----
# Simulation Parameters
toggle = BooleanToggle(True)
simoutput = HBSimulationOutput(zone_energy_use=toggle, system_energy_use=toggle, report_frequency="Monthly")  # -> report, sim_output; plug-in component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
shadowcalc = HBShadowCalculation(solar_dist="FullExterior")  # -> shadow_calc; plug-in component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
simpar = HBSimulationParameter(output=simoutput.sim_output, timestep="1", shadow_calc=shadowcalc)  # -> sim_par; plug-in component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

# ----
# Visualize Model Properties
room2dattr = DFRoom2DAttributes({"Display Name": "display_name", "Simulation Name (Identifier)": "identifier", "Floor-To-Ceiling Height": "floor_to_ceiling_height", "Floor Elevation": "floor_height", "Ceiling Elevation": "ceiling_height", "Is Ground Contact": "is_ground_contact"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}, selected="Program": "properties.energy.program_type.display_name")
data_2 = Data(flatten(model.model))
colorroom2dattr = DFColorRoom2DAttributes(df_obj=flatten(data_2), attribute=room2dattr)  # -> mesh, legend, wire_frame, values, colors; plug-in component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

# ----
# Write geoJSON
panel_5 = Panel("-78.852466")
constrloc = LBConstructLocation(name="Buffalo, NY", latitude="42.813153", longitude=panel_5, time_zone="-5", elevation="200")  # -> location; plug-in component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
pt = Point(Point(0, 0, 0))
togeojson = DFModelToGeoJSON(
    model=model.model,
    location=constrloc,
    point=pt,
    use_multiplier=Toggle(True),
    shade_dist="50",
    des_loop=gheloop.des_loop,
    write=Toggle(False))  # -> report, geojson, net_json, hb_jsons, hb_models; plug-in component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

# ----
# Run Simulation
runurbanopt = DFRunURBANopt(geojson=togeojson.geojson, epw_file=downloadepw.epw_file, sim_par=simpar, run=Toggle(False))  # -> report, scenario, osm, idf, sql, zsz, rdd, html; plug-in component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

toggle_2 = BooleanToggle(False)

# ----
# Generate DES
# Simulation Files
exportdes = DFExportDistrictEnergySystem(geojson=togeojson.geojson, scenario=runurbanopt.scenario, write=toggle_2, run=toggle_2)  # -> report, sys_param, osm, idf, sql, rdd, html, modelica; plug-in component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

# ----
# Compute District EUI for DES
toggle_3 = BooleanToggle(True)
geoprop = DFGeometryProperties(df_objs=flatten(model.model))  # -> height, floor_area, ext_wall_area, ext_win_area, volume; plug-in component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
eui = HBEndUseIntensity(sql=exportdes.sql, abs=toggle_3)  # -> eui, eui_end_use, end_uses, gross_floor; plug-in component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
division = Division(A=eui.eui_end_use, B=geoprop.floor_area)
division_2 = Division(A=eui.eui, B=geoprop.floor_area)
panel_6 = Panel(division)
panel_7 = Panel(division_2)
panel_8 = Panel(eui.end_uses)

# ----
# Visualize DES
# Performance
desenergyresult = DFReadDESEnergyResult(sql=exportdes.sql)  # -> cooling, heating, shw, pumps, heat_rejection, supplement_heat; plug-in component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
destemperatureresult = DFReadDESTemperatureResult(sql=exportdes.sql)  # -> chilled_water, hot_water, condenser, ground; plug-in component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
desloadresult = DFReadDESBuildingLoad(sql=exportdes.sql)  # -> cooling, heating, shw; plug-in component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
hourlyplot = LBHourlyPlot(data=flatten([destemperatureresult.condenser, destemperatureresult.ground]), base_pt="-400, 300, 0")  # -> report, mesh, legend, borders, labels, title, vis_set; plug-in component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

# ----
# Visualize the GHE
ghesizing = DFReadGHESizing(sys_param=exportdes.sys_param, des_loop=gheloop.des_loop)  # -> report, boreholes, bore_geo, g_function, properties, month_temps; plug-in component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

# ----
# Monthly BoreholeTemperatures Over 20 Years
graph = QuickGraph(ghesizing.month_temps, SortOrder=0)
