# Grasshopper definition des_ghe_example_custom_loads.gh (Grasshopper 1.0.8)

# ----
# Energy Properties
bldg_vintage = Dragonfly_BldgAge({"ASHRAE 90.1 2013  |  IECC 2015": "2013", "ASHRAE 90.1 2010  |  IECC 2012": "2010", "ASHRAE 90.1 2007  |  IECC 2009": "2007", "ASHRAE 90.1 2004  |  IECC 2006": "2004", "1980-2004 (CBECS)": "1980_2004", "Pre-1980 (CBECS)": "pre_1980"}, selected="ASHRAE 90.1 2013  |  IECC 2015")
constr_type = Dragonfly_BldgAge({"SteelFramed", "WoodFramed", "Mass", "Metal Building"}, selected="SteelFramed")
climate_zone = Dragonfly_BldgAge({"1 - Very Hot": "1", "2 - Hot": "2", "3 - Warm": "3", "4 - Mixed": "4", "5 - Cool": "5", "6 - Cold": "6", "7 - Very Cold": "7", "8 - Subarctic": "8"}, selected="5 - Cool")
constrsetclimate = HBConstructionSetByClimate(climate_zone=climate_zone, vintage=bldg_vintage, constr_type=constr_type)  # -> constr_set; plug-in component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
bldgprograms = HBBuildingPrograms({"LargeOffice", "MediumOffice", "SmallOffice", "MidriseApartment", "HighriseApartment", "Retail", "StripMall", "PrimarySchool", "SecondarySchool", "SmallHotel", "LargeHotel", "Hospital", "Outpatient", "Laboratory", "Warehouse", "SuperMarket", "FullServiceRestaurant", "QuickServiceRestaurant", "Courthouse", "LargeDataCenterHighITE", "LargeDataCenterLowITE", "SmallDataCenterHighITE", "SmallDataCenterLowITE"}, selected="MidriseApartment")
data = Data(constrsetclimate)

# ----
# Basic Building Properties
building_names = Panel("""Residential 2
Residential 4""")
number_of_stories = Panel("""3
1""")
floor_to_floor_m = Panel("3.5")
footprints = Geometry([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])
panel = Panel("""3
4""")
perimeter_depth_m = Panel("10")
data_2 = Data(simplify(graft(building_names)))
item = ListItem(List=flatten(footprints), Index=panel, Wrap=True)  # -> simplify(graft(Item))
dup = DuplicateData(Data=floor_to_floor_m, Number=number_of_stories, Order=True)  # -> simplify(Data)

# ----
# Create Buildings
buildingfootprint = DFBuildingFromFootprint(
    footprint_geo=item,
    floor_to_floor=dup,
    perim_offset=perimeter_depth_m,
    name=data_2,
    program=bldgprograms,
    constr_set=data,
    run=Toggle(True))  # -> report, buildings; plug-in component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
bang = ExplodeTree(Data=simplify(buildingfootprint.buildings))  # -> Branch0, Branch1

# ----
# Building 1
# Custom Loads
sensible_heating = Data(["49388.1", "52037.6", "52740.3", "53656.5", "54448.7", "54316.8"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])
sensible_cooling = Data([0, 0, 0, 0, 0, 0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])
water_heating = Data(["1913.9", "930", "237.1", "225.6", "903.2", "6109.6"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])
sensible_cooling_2 = Panel(sensible_cooling)
water_heating_2 = Panel(water_heating)
sensible_heating_2 = Panel(sensible_heating)
constrheader = LBConstructHeader(data_type="Power", unit="W")  # -> header; plug-in component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
data_3 = LBConstructData(header=constrheader, values=sensible_heating_2)  # -> data; plug-in component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
data_4 = LBConstructData(header=constrheader, values=water_heating_2)  # -> data; plug-in component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
data_5 = LBConstructData(header=constrheader, values=sensible_cooling_2)  # -> data; plug-in component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

# ----
# Building 2
# Custom Loads
sensible_cooling_3 = Data([0, 0, 0, 0, 0, 0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])
sensible_heating_3 = Data(["27558.6", "28107.3", "28302.6", "28370.1", "28486.6", "28335.6"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])
water_heating_3 = Data(["532.9", "258.9", "66", "62.8", "251.5", "1701.1"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])
sensible_cooling_4 = Panel(sensible_cooling_3)
sensible_heating_4 = Panel(sensible_heating_3)
water_heating_4 = Panel(water_heating_3)
constrheader_2 = LBConstructHeader(data_type="Power", unit="W")  # -> header; plug-in component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
data_6 = LBConstructData(header=constrheader_2, values=sensible_heating_4)  # -> data; plug-in component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
data_7 = LBConstructData(header=constrheader_2, values=water_heating_4)  # -> data; plug-in component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
data_8 = LBConstructData(header=constrheader_2, values=sensible_cooling_4)  # -> data; plug-in component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

assignbldgload = DFAssignDESBuildingLoads(building=bang.Branch0, cooling=data_5, heating=data_3, hot_water=data_4)  # -> building; plug-in component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
assignbldgload_2 = DFAssignDESBuildingLoads(building=bang.Branch1, cooling=data_8, heating=data_6, hot_water=data_7)  # -> building; plug-in component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

# ----
# Create GHE District System
panel_2 = Panel("5")
gheborehole = DFGHEBoreholeParameter(min_spacing=panel_2, max_spacing="35", max_depth="135")  # -> borehole; plug-in component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
ground_heat_exchanger = Geometry(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)
thermalconnectors = Geometry([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])
gheloop = DFGHEThermalLoop(
    ghe_geo=flatten(ground_heat_exchanger),
    connector_geo=flatten(thermalconnectors),
    clockwise=Toggle(False),
    borehole=gheborehole,
    name="Redisential GHE Loop")  # -> report, des_loop; plug-in component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

# ----
# Download EPW File
panel_3 = Panel("https://energyplus-weather.s3.amazonaws.com/north_and_central_america_wmo_region_4/USA/NY/USA_NY_Buffalo-Greater.Buffalo.Intl.AP.725280_TMY/USA_NY_Buffalo-Greater.Buffalo.Intl.AP.725280_TMY.zip")
downloadepw = LBDownloadWeather(weather_URL=panel_3)  # -> epw_file, stat_file, ddy_file; plug-in component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

# ----
# Create Model
panel_4 = Panel("DES_GHE_Custom_Load")
model = DFModel(buildings=flatten([assignbldgload, assignbldgload_2]), name=panel_4)  # -> report, model; plug-in component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

# ----
# Visualize Model Properties
room2dattr = DFRoom2DAttributes({"Display Name": "display_name", "Simulation Name (Identifier)": "identifier", "Floor-To-Ceiling Height": "floor_to_ceiling_height", "Floor Elevation": "floor_height", "Ceiling Elevation": "ceiling_height", "Is Ground Contact": "is_ground_contact"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}, selected="Program": "properties.energy.program_type.display_name")
data_9 = Data(flatten(model.model))
colorroom2dattr = DFColorRoom2DAttributes(df_obj=flatten(data_9), attribute=room2dattr)  # -> mesh, legend, wire_frame, values, colors; plug-in component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

# ----
# Write URBANopt DES Files
panel_5 = Panel("Buffalo, NY")
constrloc = LBConstructLocation(name=panel_5, latitude="42.813153", longitude="-78.852466", time_zone="-5", elevation="200")  # -> location; plug-in component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
pt = Point(Point(0, 0, 0))
todes = DFModelToDES(
    model=model.model,
    des_loop=gheloop.des_loop,
    epw_file=downloadepw.epw_file,
    location=constrloc,
    point=pt,
    write=Toggle(False))  # -> report, geojson, scenario; plug-in component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

toggle = BooleanToggle(False)

# ----
# Generate DES
exportdes = DFExportDistrictEnergySystem(geojson=todes.geojson, scenario=todes.scenario, write=toggle, run=toggle)  # -> report, sys_param, osm, idf, sql, rdd, html, modelica; plug-in component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

# ----
# Compute District EUI for DES
toggle_2 = BooleanToggle(True)
geoprop = DFGeometryProperties(df_objs=flatten(model.model))  # -> height, floor_area, ext_wall_area, ext_win_area, volume; plug-in component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
eui = HBEndUseIntensity(sql=exportdes.sql, abs=toggle_2)  # -> eui, eui_end_use, end_uses, gross_floor; plug-in component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
division = Division(A=eui.eui_end_use, B=geoprop.floor_area)
division_2 = Division(A=eui.eui, B=geoprop.floor_area)
panel_6 = Panel(division)
panel_7 = Panel(division_2)
panel_8 = Panel(eui.end_uses)

# ----
# Visualize DES
# Performance
desenergyresult = DFReadDESEnergyResult(sql=exportdes.sql)  # -> cooling, heating, shw, pumps, heat_rejection, supplement_heat; plug-in component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
destemperatureresult = DFReadDESTemperatureResult(sql=exportdes.sql)  # -> chilled_water, hot_water, condenser, ground; plug-in component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
desloadresult = DFReadDESBuildingLoad(sql=exportdes.sql)  # -> cooling, heating, shw; plug-in component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
hourlyplot = LBHourlyPlot(data=flatten([destemperatureresult.condenser, destemperatureresult.ground]), base_pt="-400, 300, 0")  # -> report, mesh, legend, borders, labels, title, vis_set; plug-in component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

ghesizing = DFReadGHESizing(sys_param=exportdes.sys_param, des_loop=gheloop.des_loop)  # -> report, boreholes, bore_geo, g_function, properties, month_temps; plug-in component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
panel_9 = Panel(ghesizing.report)
graph = QuickGraph(ghesizing.month_temps, SortOrder=0)
